# Grasshopper definition 01_Abaco_pareti.ghx (Grasshopper 1.0.8)
# plug-ins: IFC Viewer

# 01 | ABACO PARETI: Leggi -> filtra IfcWall -> ordina -> leggi proprieta e misure -> esporta CSV.
# Modello gia incorporato: 3 pareti, volume totale 12 m3. Il CSV contiene attributi IFC, mentre le misure sono mostrate nei pannelli.
# Modifica il percorso solo per usare un altro IFC. WRITE CSV salva su richiesta; Overwrite inizialmente False.
read = Button()
write_csv = Button()
parametro_chiave_modificabile = Panel("IFC.Property.Pset_WallCommon.FireRating")
file_ifc_cambia_percorso_poi_premi_read = Panel("C:\Users\g.pacini\Documents\Repository\IFC Viewer\examples\tutorial_A.ifc")
modello_a = ReadIFC(Files=flatten(file_ifc_cambia_percorso_poi_premi_read), Read=read)  # -> Models, Elements, Report
ifcwall = IFCFilterProperty(Elements=modello_a.Elements, Key="IFC.Class", Operator="=", Value="IfcWall", CaseSensitive=False)  # -> Matched, Rejected, Mask
ifc_sort = IFCSort(Elements=ifcwall.Matched, Key="IFC.Name", Numeric=False, Descending=False)
ifc_data = IFCElements(Elements=ifc_sort, OffsetMetres=Vector(0, 0, 0))  # -> Geometry, Elements, Classes, GlobalIds, Keys, Values, JSON, Colors
pareti = CustomPreview(Geometry=ifc_data.Geometry, Material=ifc_data.Colors)
ifc_value = IFCPropertyValue(Elements=ifc_sort, Key=parametro_chiave_modificabile)  # -> Values, Found, Numbers, IsNumeric
ifc_metrics = IFCGeometryMetrics(Elements=ifc_sort, OffsetMetres=Vector(0, 0, 0))  # -> AreaM2, VolumeM3, HasVolume, DimensionsMetres, Boxes, Centers
pareti_ordinate = Panel(ifc_sort)
read_ifc = Panel("MODELLO A")
colonne_csv_una_chiave_per_riga = Panel("""IFC.GlobalId
IFC.Name
IFC.Class
IFC.Container.name
IFC.Property.Progetto.Codice
IFC.Property.Pset_WallCommon.FireRating""")
destinazione_csv_modificabile = Panel("C:\Users\g.pacini\Documents\Repository\IFC Viewer\exports\01_abaco_pareti.csv")
ifc_csv = IFCExportCSV(
    Elements=flatten(ifc_sort),
    Keys=flatten(colonne_csv_una_chiave_per_riga),
    File=destinazione_csv_modificabile,
    Write=write_csv,
    Overwrite=False,
    Delimiter=";",
    ExcelSafe=True)
ifc_filter_property = Panel("IfcWall")
ifc_property_value = Panel("IFC Value")
ifc_export_csv = Panel("IFC CSV")
resistenza_al_fuoco_ordine_dei_nomi = Panel(ifc_value.Values)
ifc_sort_2 = Panel("IFC Sort")
file_salvato_vuoto_finche_non_premi_writ = Panel(ifc_csv)  # "FILE SALVATO | vuoto finche non premi WRITE"
ifc_elements = Panel("IFC Data")
ifc_geometry_metrics = Panel("IFC Metrics")
volumi_geometrici_m3 = Panel(ifc_metrics.VolumeM3)
custom_preview = Panel("PARETI")
