# Grasshopper definition 02_Piani_e_colori.ghx (Grasshopper 1.0.8)
# plug-ins: IFC Viewer

# 02 | PIANI, COLORI E BAKE: Leggi -> seleziona gli oggetti con mesh -> raggruppa per piano e colora la preview -> bake.
# Attesi: Piano terra 4 oggetti, Piano primo 2 oggetti. Il filtro esclude i contenitori spaziali senza mesh.
# BAKE crea 6 mesh con tutti i parametri e layer per classe IFC. I colori per piano valgono per la preview; i colori del bake seguono la classe IFC.
read = Button()
bake = Button()
raggruppa_e_colora_per = Panel("IFC.Container.name")
file_ifc_cambia_percorso_poi_premi_read = Panel("C:\Users\g.pacini\Documents\Repository\IFC Viewer\examples\tutorial_A.ifc")
modello_a = ReadIFC(Files=flatten(file_ifc_cambia_percorso_poi_premi_read), Read=read)  # -> Models, Elements, Report
ok = IFCFilterProperty(Elements=modello_a.Elements, Key="IFC.GeometryStatus", Operator="=", Value="ok", CaseSensitive=False)  # -> Matched, Rejected, Mask
ifc_group = IFCGroupBy(Elements=ok.Matched, Key=raggruppa_e_colora_per)  # -> Groups, Labels, Counts, KeyExists
ifc_colors = IFCColorBy(Elements=ok.Matched, Key=raggruppa_e_colora_per, OffsetMetres=Vector(0, 0, 0))  # -> Geometry, Colors, Legend, LegendColors, Counts, KeyExists
colori_per_piano = CustomPreview(Geometry=ifc_colors.Geometry, Material=ifc_colors.Colors)
ifc_bake = BakeIFC(Elements=flatten(ifc_group.Groups), Bake=bake, RootLayer="Esempio_02", Update=True, OffsetMetres=Vector(0, 0, 0))  # -> ObjectIDs, Report
ifc_baked = IFCReadBaked(RhinoObjectIDs=ifc_bake.ObjectIDs, Root="Esempio_02", Refresh=False)  # -> RhinoIDs, Geometry, Keys, Values, MetadataJSON, NotFound
read_ifc = Panel("MODELLO A")
ifc_filter_property = Panel("ok")
ifc_group_by = Panel("IFC Group")
bake_ifc = Panel("IFC Bake")
bake_layer_esempio_02_sorgente_ifcclass = Panel(ifc_bake.Report)
guid_rhino_degli_oggetti_creati = Panel(ifc_baked.RhinoIDs)
piani_un_ramo_per_etichetta = Panel(ifc_group.Labels)
ifc_color_by = Panel("IFC Colors")
oggetti_per_piano = Panel(ifc_group.Counts)
custom_preview = Panel("COLORI PER PIANO")
ifc_read_baked = Panel("IFC Baked")
legenda_stesso_ordine_dei_colori_c = Panel(ifc_colors.Legend)
