# Grasshopper definition 03_Controllo_parametri.ghx (Grasshopper 1.0.8)
# plug-ins: IFC Viewer

col = Colour(RGB(34, 139, 34))
col_2 = Colour(RGB(220, 20, 60))
# 03 | CONTROLLO PARAMETRI: Leggi -> filtra le pareti -> controlla Codice e FireRating -> evidenzia gli errori -> esporta le sole pareti da correggere.
# Verde: 2 pareti complete. Rosso: 1 parete senza Progetto.Codice. La geometria e richiesta.
# Le chiavi nel pannello possono essere sostituite con i parametri obbligatori del tuo progetto.
read = Button()
write_csv = Button()
chiavi_obbligatorie_una_per_riga = Panel("""IFC.Property.Progetto.Codice
IFC.Property.Pset_WallCommon.FireRating""")
file_ifc_cambia_percorso_poi_premi_read = Panel("C:\Users\g.pacini\Documents\Repository\IFC Viewer\examples\tutorial_A.ifc")
modello_a = ReadIFC(Files=flatten(file_ifc_cambia_percorso_poi_premi_read), Read=read)  # -> Models, Elements, Report
ifcwall = IFCFilterProperty(Elements=modello_a.Elements, Key="IFC.Class", Operator="=", Value="IfcWall", CaseSensitive=False)  # -> Matched, Rejected, Mask
ifc_check = IFCCheckData(Elements=ifcwall.Matched, RequiredKeys=chiavi_obbligatorie_una_per_riga, RequireGeometry=True)  # -> Passed, Failed, Valid, Issues
conformi_verde = IFCElements(Elements=ifc_check.Passed, OffsetMetres=Vector(0, 0, 0))  # -> Geometry, Elements, Classes, GlobalIds, Keys, Values, JSON, Colors
conformi_verde_2 = CustomPreview(Geometry=conformi_verde.Geometry, Material=col)
da_correggere_rosso = IFCElements(Elements=ifc_check.Failed, OffsetMetres=Vector(0, 0, 0))  # -> Geometry, Elements, Classes, GlobalIds, Keys, Values, JSON, Colors
da_correggere_rosso_2 = CustomPreview(Geometry=da_correggere_rosso.Geometry, Material=col_2)
parete_con_codice_assente = Panel(ifc_check.Failed)
read_ifc = Panel("MODELLO A")
colonne_csv_una_chiave_per_riga = Panel("""IFC.GlobalId
IFC.Name
IFC.Class
IFC.Container.name
IFC.Property.Progetto.Codice
IFC.Property.Pset_WallCommon.FireRating""")
destinazione_csv_modificabile = Panel("C:\Users\g.pacini\Documents\Repository\IFC Viewer\exports\03_parametri_mancanti.csv")
ifc_csv = IFCExportCSV(
    Elements=flatten(ifc_check.Failed),
    Keys=flatten(colonne_csv_una_chiave_per_riga),
    File=destinazione_csv_modificabile,
    Write=write_csv,
    Overwrite=False,
    Delimiter=";",
    ExcelSafe=True)
ifc_filter_property = Panel("IfcWall")
ifc_export_csv = Panel("IFC CSV")
ifc_elements = Panel("CONFORMI | verde")
ifc_check_data = Panel("IFC Check")
file_salvato_vuoto_finche_non_premi_writ = Panel(ifc_csv)  # "FILE SALVATO | vuoto finche non premi WRITE"
problemi_ramo_indice_della_parete = Panel(ifc_check.Issues)
ifc_elements_2 = Panel("DA CORREGGERE | rosso")
