# Grasshopper definition 04_Confronto_revisioni.ghx (Grasshopper 1.0.8)
# plug-ins: IFC Viewer

col = Colour(RGB(34, 139, 34))
col_2 = Colour(RGB(220, 20, 60))
col_3 = Colour(RGB(255, 140, 0))
col_4 = Colour(RGB(211, 211, 211))
# 04 | CONFRONTO REVISIONI A / B: Due modelli incorporati -> confronto per GlobalId -> preview degli esiti e CSV degli oggetti modificati.
# B contiene: 1 parete aggiunta (verde), 1 rimossa (rosso), 2 oggetti modificati (arancio), 8 record invariati (grigio; 3 hanno mesh).
# Le modifiche sono FireRating REI 60 -> REI 90 e lo spostamento di un pilastro. I rimossi usano la geometria di A, gli altri quella di B.
read = Button()
read_2 = Button()
write_csv = Button()
file_ifc_cambia_percorso_poi_premi_read = Panel("C:\Users\g.pacini\Documents\Repository\IFC Viewer\examples\tutorial_A.ifc")
prima_a = ReadIFC(Files=flatten(file_ifc_cambia_percorso_poi_premi_read), Read=read)  # -> Models, Elements, Report
file_ifc_cambia_percorso_poi_premi_read_2 = Panel("C:\Users\g.pacini\Documents\Repository\IFC Viewer\examples\tutorial_B.ifc")
dopo_b = ReadIFC(Files=flatten(file_ifc_cambia_percorso_poi_premi_read_2), Read=read_2)  # -> Models, Elements, Report
ifc_diff = IFCCompareRevisions(Before=prima_a.Models, After=dopo_b.Models, CompareMeshes=True, PrecisionMetres=1e-06)  # -> Added, Removed, ChangedBefore, ChangedAfter, Unchanged, ChangedFields, Report
aggiunti_verde = IFCElements(Elements=ifc_diff.Added, OffsetMetres=Vector(0, 0, 0))  # -> Geometry, Elements, Classes, GlobalIds, Keys, Values, JSON, Colors
aggiunti_verde_2 = CustomPreview(Geometry=aggiunti_verde.Geometry, Material=col)
rimossi_rosso = IFCElements(Elements=ifc_diff.Removed, OffsetMetres=Vector(0, 0, 0))  # -> Geometry, Elements, Classes, GlobalIds, Keys, Values, JSON, Colors
rimossi_rosso_2 = CustomPreview(Geometry=rimossi_rosso.Geometry, Material=col_2)
modificati_arancio = IFCElements(Elements=ifc_diff.ChangedAfter, OffsetMetres=Vector(0, 0, 0))  # -> Geometry, Elements, Classes, GlobalIds, Keys, Values, JSON, Colors
modificati_arancio_2 = CustomPreview(Geometry=modificati_arancio.Geometry, Material=col_3)
invariati_grigio = IFCElements(Elements=ifc_diff.Unchanged, OffsetMetres=Vector(0, 0, 0))  # -> Geometry, Elements, Classes, GlobalIds, Keys, Values, JSON, Colors
invariati_grigio_2 = CustomPreview(Geometry=invariati_grigio.Geometry, Material=col_4)
campi_modificati_rami_allineati_a_change = Panel(ifc_diff.ChangedFields)  # "CAMPI MODIFICATI | rami allineati a Changed After"
read_ifc = Panel("PRIMA | A")
read_ifc_2 = Panel("DOPO | B")
colonne_csv_una_chiave_per_riga = Panel("""IFC.GlobalId
IFC.Name
IFC.Class
IFC.Container.name
IFC.Property.Progetto.Codice
IFC.Property.Pset_WallCommon.FireRating""")
destinazione_csv_modificabile = Panel("C:\Users\g.pacini\Documents\Repository\IFC Viewer\exports\04_oggetti_modificati.csv")
ifc_csv = IFCExportCSV(
    Elements=flatten(ifc_diff.ChangedAfter),
    Keys=flatten(colonne_csv_una_chiave_per_riga),
    File=destinazione_csv_modificabile,
    Write=write_csv,
    Overwrite=False,
    Delimiter=";",
    ExcelSafe=True)
ifc_compare_revisions = Panel("IFC Diff")
ifc_export_csv = Panel("IFC CSV")
report_confronto = Panel(ifc_diff.Report)
ifc_elements = Panel("AGGIUNTI | verde")
ifc_elements_2 = Panel("MODIFICATI | arancio")
file_salvato_vuoto_finche_non_premi_writ = Panel(ifc_csv)  # "FILE SALVATO | vuoto finche non premi WRITE"
ifc_elements_3 = Panel("RIMOSSI | rosso")
ifc_elements_4 = Panel("INVARIATI | grigio")
