# Grasshopper definition 05_Origine_locale_export.ghx (Grasshopper 1.0.8)
# plug-ins: IFC Viewer

# 05 | ORIGINE LOCALE, EXPORT 3DM E ARCHIVIO: Coordinate di esempio intorno a X=650000 m, Y=4860000 m -> offset XY comune a preview, bake, misure ed export 3DM.
# La quota Z resta invariata. Il 3DM contiene 6 mesh con layer e User Text; SAVE ARCHIVE conserva anche i record senza geometria e l'IFC originale.
# Il cambio origine e una traslazione del modello per Rhino; non effettua trasformazioni GIS. Modifica le destinazioni prima di esportare.
read = Button()
write_3dm = Button()
bake = Button()
save_archive = Button()
destinazione_3dm = Panel("C:\Users\g.pacini\Documents\Repository\IFC Viewer\exports\05_modello_locale.3dm")
cartella_archivio_ifc_completo = Panel("C:\Users\g.pacini\Documents\Repository\IFC Viewer\exports")
file_ifc_cambia_percorso_poi_premi_read = Panel("C:\Users\g.pacini\Documents\Repository\IFC Viewer\examples\tutorial_coordinate_grandi.ifc")
modello_a = ReadIFC(Files=flatten(file_ifc_cambia_percorso_poi_premi_read), Read=read)  # -> Models, Elements, Report
ok = IFCFilterProperty(Elements=modello_a.Elements, Key="IFC.GeometryStatus", Operator="=", Value="ok", CaseSensitive=False)  # -> Matched, Rejected, Mask
ifc_origin = IFCLocalOrigin(Elements=ok.Matched, Mode="XY center")  # -> OffsetMetres, OriginalOriginMetres
ifc_data = IFCElements(Elements=ok.Matched, OffsetMetres=ifc_origin.OffsetMetres)  # -> Geometry, Elements, Classes, GlobalIds, Keys, Values, JSON, Colors
preview_locale = CustomPreview(Geometry=ifc_data.Geometry, Material=ifc_data.Colors)
ifc_metrics = IFCGeometryMetrics(Elements=ok.Matched, OffsetMetres=ifc_origin.OffsetMetres)  # -> AreaM2, VolumeM3, HasVolume, DimensionsMetres, Boxes, Centers
ifc_3dm = IFCExport3DM(
    Elements=flatten(ok.Matched),
    File=destinazione_3dm,
    Write=write_3dm,
    Overwrite=False,
    OffsetMetres=ifc_origin.OffsetMetres,
    RootLayer="Esempio_05")  # -> SavedFile, Report
ifc_bake = BakeIFC(Elements=flatten(ok.Matched), Bake=bake, RootLayer="Esempio_05", Update=True, OffsetMetres=ifc_origin.OffsetMetres)  # -> ObjectIDs, Report
ifc_save = SaveIFCArchive(Models=flatten(modello_a.Models), Directory=cartella_archivio_ifc_completo, Save=save_archive, Overwrite=False)
read_ifc = Panel("MODELLO A")
ifc_filter_property = Panel("ok")
ifc_export_3dm = Panel("IFC 3DM")
save_ifc_archive = Panel("IFC Save")
report_export_3dm = Panel(ifc_3dm.Report)
archivio_salvato_coordinate_originali = Panel(ifc_save)
ifc_local_origin = Panel("IFC Origin")
ifc_elements = Panel("IFC Data")
offset_xy_metri = Panel(ifc_origin.OffsetMetres)
custom_preview = Panel("PREVIEW LOCALE")
centri_nelle_unita_rhino = Panel(ifc_metrics.Centers)
ifc_geometry_metrics = Panel("IFC Metrics")
bake_ifc = Panel("IFC Bake")
