# Grasshopper definition 06_Esplora_modello.ghx (Grasshopper 1.0.8)
# plug-ins: IFC Viewer

# 06 | ESPLORA MODELLO, CHIAVI E IDENTIFICATIVI: Read IFC -> Model Info per schema, unita e conteggi; Property Keys per trovare le chiavi esatte; Select IDs per isolare un oggetto.
# Modello incorporato: IFC4, 11 record e 6 mesh. Il pannello ID contiene un GlobalId valido e ID_NON_PRESENTE per mostrare gli ID non trovati.
# Cambia la ricerca delle chiavi, copia una chiave nel pannello PARAMETRO e consulta valore, presenza e JSON dell'oggetto selezionato.
read = Button()
cerca_nel_nome_della_chiave = Panel("FireRating")
id_globalid_step_id_oppure_ifc_key = Panel("""3xCZU1$HbDZgoec6JcBxEt
ID_NON_PRESENTE""")
parametro_incolla_una_chiave_da_property = Panel("IFC.Property.Pset_WallCommon.FireRating")  # "PARAMETRO | incolla una chiave da Property Keys"
file_ifc_cambia_percorso_poi_premi_read = Panel("C:\Users\g.pacini\Documents\Repository\IFC Viewer\examples\tutorial_A.ifc")
modello_a = ReadIFC(Files=flatten(file_ifc_cambia_percorso_poi_premi_read), Read=read)  # -> Models, Elements, Report
ifc_info = IFCModelInfo(Models=modello_a.Models)  # -> Names, Schemas, Products, Meshes, LengthToMetres, Classes, ClassCounts, JSON
ifc_keys = IFCPropertyKeys(Elements=modello_a.Elements, Search=cerca_nel_nome_della_chiave)  # -> Keys, Occurrences
ifc_ids = IFCSelectIDs(Elements=modello_a.Elements, IDs=id_globalid_step_id_oppure_ifc_key)  # -> Elements, Indices, NotFound, Ambiguous
ifc_data = IFCElements(Elements=ifc_ids.Elements, OffsetMetres=Vector(0, 0, 0))  # -> Geometry, Elements, Classes, GlobalIds, Keys, Values, JSON, Colors
solo_oggetto_selezionato = CustomPreview(Geometry=ifc_data.Geometry, Material=ifc_data.Colors)
ifc_value = IFCPropertyValue(Elements=ifc_ids.Elements, Key=parametro_incolla_una_chiave_da_property)  # -> Values, Found, Numbers, IsNumeric
read_ifc = Panel("MODELLO A")
ifc_model_info = Panel("IFC Info")
ifc_property_keys = Panel("IFC Keys")
ifc_select_ids = Panel("IFC IDs")
ifc_property_value = Panel("IFC Value")
schema = Panel(ifc_info.Schemas)
classi = Panel(ifc_info.Classes)
chiavi_esatte_copia_una_chiave_sotto = Panel(ifc_keys.Keys)
id_non_trovati_esempio_intenzionale = Panel(ifc_ids.NotFound)
valore_effettivo = Panel(ifc_value.Values)
json_completo_doppio_clic_per_consultare = Panel(ifc_data.JSON)
ifc_elements = Panel("IFC Data")
prodotti_record = Panel(ifc_info.Products)
custom_preview = Panel("SOLO OGGETTO SELEZIONATO")
presente_distingue_assente_da_valore_vuo = Panel(ifc_value.Found)  # "PRESENTE | distingue assente da valore vuoto"
conteggi_per_classe = Panel(ifc_info.ClassCounts)
mesh = Panel(ifc_info.Meshes)
occorrenze_stessa_riga_della_chiave = Panel(ifc_keys.Occurrences)
scala_lunghezze_ifc_metri = Panel(ifc_info.LengthToMetres)
