# Grasshopper definition 07_Filtri_numerici.ghx (Grasshopper 1.0.8)
# plug-ins: IFC Viewer

col = Colour(RGB(70, 130, 180))
# 07 | FILTRI NUMERICI, BOOLEANI E COMPONENTI NATIVI: Pareti -> Sort numerico per Tutorial.Indice -> filtro >= soglia -> filtro Selezionabile=true -> preview, somma dei volumi e CSV.
# Gli indici sono 2, 10, 1: Sort numerico produce 1, 2, 10. Con soglia 2 sono selezionate due pareti e il volume totale e 9 m3.
# Sposta lo slider a 10: resta una parete, 4.5 m3. Il flag false della parete con indice 1 e un valore presente, non un parametro mancante.
read = Button()
soglia_indice = Slider(2, range=0..12)
write_csv = Button()
chiave_numerica = Panel("IFC.Property.Tutorial.Indice")
file_ifc_cambia_percorso_poi_premi_read = Panel("C:\Users\g.pacini\Documents\Repository\IFC Viewer\examples\tutorial_numeri.ifc")
modello_a = ReadIFC(Files=flatten(file_ifc_cambia_percorso_poi_premi_read), Read=read)  # -> Models, Elements, Report
solo_ifcwall = IFCElements(Elements=modello_a.Elements, Classes="IfcWall", OffsetMetres=Vector(0, 0, 0))  # -> Geometry, Elements, Classes, GlobalIds, Keys, Values, JSON, Colors
numeric_true = IFCSort(Elements=solo_ifcwall.Elements, Key="IFC.Property.Tutorial.Indice", Numeric=True, Descending=False)
indici_ordinati = IFCPropertyValue(Elements=numeric_true, Key="IFC.Property.Tutorial.Indice")  # -> Values, Found, Numbers, IsNumeric
soglia = IFCFilterProperty(Elements=numeric_true, Key=chiave_numerica, Operator=">=", Value=soglia_indice, CaseSensitive=False)  # -> Matched, Rejected, Mask
read_ifc = Panel("MODELLO A")
colonne_csv_una_chiave_per_riga = Panel("""IFC.GlobalId
IFC.Name
IFC.Property.Tutorial.Indice
IFC.Property.Tutorial.Selezionabile""")
destinazione_csv_modificabile = Panel("C:\Users\g.pacini\Documents\Repository\IFC Viewer\exports\07_filtro_numerico.csv")
ifc_elements = Panel("SOLO IfcWall")
ifc_filter_property = Panel("2")
ifc_geometry_metrics = Panel("IFC Metrics")
ifc_export_csv = Panel("IFC CSV")
chiave_booleana_confronto_testuale_true = Panel("IFC.Property.Tutorial.Selezionabile")
selezionabile = IFCFilterProperty(Elements=soglia.Matched, Key=chiave_booleana_confronto_testuale_true, Operator="=", Value="true", CaseSensitive=False)  # -> Matched, Rejected, Mask
pareti_filtrate = IFCElements(Elements=selezionabile.Matched, OffsetMetres=Vector(0, 0, 0))  # -> Geometry, Elements, Classes, GlobalIds, Keys, Values, JSON, Colors
pareti_filtrate_2 = CustomPreview(Geometry=pareti_filtrate.Geometry, Material=col)
ifc_metrics = IFCGeometryMetrics(Elements=selezionabile.Matched, OffsetMetres=Vector(0, 0, 0))  # -> AreaM2, VolumeM3, HasVolume, DimensionsMetres, Boxes, Centers
ma = MassAddition(Input=ifc_metrics.VolumeM3)  # -> Result, PartialResults
ifc_csv = IFCExportCSV(
    Elements=flatten(selezionabile.Matched),
    Keys=flatten(colonne_csv_una_chiave_per_riga),
    File=destinazione_csv_modificabile,
    Write=write_csv,
    Overwrite=False,
    Delimiter=";",
    ExcelSafe=True)
ifc_sort = Panel("NUMERIC = TRUE")
mass_addition = Panel("MA")
ifc_filter_property_2 = Panel("true")
file_salvato_vuoto_finche_non_premi_writ = Panel(ifc_csv)  # "FILE SALVATO | vuoto finche non premi WRITE"
totale_volumi_m3 = Panel(ma.Result)
ifc_property_value = Panel("INDICI ORDINATI")
ifc_elements_2 = Panel("PARETI FILTRATE")
numeri_1_2_10 = Panel(indici_ordinati.Numbers)
