# Grasshopper definition 08_Bake_e_rilettura.ghx (Grasshopper 1.0.8)
# plug-ins: IFC Viewer

# 08 | BAKE E RILETTURA DEGLI ATTRIBUTI RHINO: Read IFC -> oggetti con mesh -> Bake IFC -> Read Baked: premi BAKE e consulta GUID Rhino, chiavi, valori e JSON.
# Attesi: 6 mesh, layer Esempio_08::sorgente::IfcClass, tutti i parametri in User Text. UPDATE e True: un secondo bake aggiorna gli stessi oggetti.
# Se modifichi gli User Text in Rhino premi REFRESH. JSON conserva il record IFC originale del bake. Salva il documento .3dm per conservare gli oggetti.
read = Button()
bake = Button()
refresh = Button()
file_ifc_cambia_percorso_poi_premi_read = Panel("C:\Users\g.pacini\Documents\Repository\IFC Viewer\examples\tutorial_A.ifc")
modello_a = ReadIFC(Files=flatten(file_ifc_cambia_percorso_poi_premi_read), Read=read)  # -> Models, Elements, Report
ok = IFCFilterProperty(Elements=modello_a.Elements, Key="IFC.GeometryStatus", Operator="=", Value="ok", CaseSensitive=False)  # -> Matched, Rejected, Mask
ifc_data = IFCElements(Elements=ok.Matched, OffsetMetres=Vector(0, 0, 0))  # -> Geometry, Elements, Classes, GlobalIds, Keys, Values, JSON, Colors
anteprima_prima_del_bake = CustomPreview(Geometry=ifc_data.Geometry, Material=ifc_data.Colors)
ifc_bake = BakeIFC(Elements=flatten(ok.Matched), Bake=bake, RootLayer="Esempio_08", Update=True, OffsetMetres=Vector(0, 0, 0))  # -> ObjectIDs, Report
ifc_baked = IFCReadBaked(RhinoObjectIDs=ifc_bake.ObjectIDs, Root="Esempio_08", Refresh=refresh)  # -> RhinoIDs, Geometry, Keys, Values, MetadataJSON, NotFound
lng = ListLength(List=ifc_baked.RhinoIDs)
report_bake = Panel(ifc_bake.Report)
guid_rhino_diversi_dai_globalid_ifc = Panel(ifc_baked.RhinoIDs)
read_ifc = Panel("MODELLO A")
ifc_filter_property = Panel("ok")
bake_ifc = Panel("IFC Bake")
chiavi_user_text_un_ramo_per_oggetto = Panel(ifc_baked.Keys)
metadati_ifc_originali_json = Panel(ifc_baked.MetadataJSON)
ifc_elements = Panel("IFC Data")
ifc_read_baked = Panel("IFC Baked")
# Custom Preview: ANTEPRIMA PRIMA DEL BAKE
list_length = Panel("Lng")
valori_righe_allineate_alle_chiavi = Panel(ifc_baked.Values)
# DOPO IL BAKE: Disattiva Custom Preview per vedere solo gli oggetti Rhino. Gli attributi si trovano in Proprieta > Testo utente attributo.
oggetti_rhino_0_prima_6_dopo_bake = Panel(lng)
