# Grasshopper definition 09_Modifica_dati_IFC.ghx (Grasshopper 1.0.8)
# plug-ins: Meerkat

# 09 | MODIFICA DATI IFC: Read -> seleziona pareti -> prepara attributi e proprieta -> WRITE IFC. Il modello originale non cambia.
# Modifica i pannelli e scegli un NUOVO percorso .ifc. On type=False limita le modifiche alle istanze selezionate.
# WRITE salva il modello completo con le modifiche. Per ispezionare il risultato, apri il percorso salvato con Read IFC.
read = Button()
write_ifc = Button()
property_set = Panel("Pset_WallCommon")
proprieta = Panel("FireRating")
nuovo_valore = Panel("REI 90")
file_ifc_cambia_percorso_poi_premi_read = Panel("C:\Users\g.pacini\Documents\Repository\IFC Viewer\examples\tutorial_A.ifc")
modello_a = ReadIFC(Files=flatten(file_ifc_cambia_percorso_poi_premi_read), Read=read)  # -> Models, Elements, Report
ifcwall = IFCFilterProperty(Elements=modello_a.Elements, Key="IFC.Class", Operator="=", Value="IfcWall", CaseSensitive=False)  # -> Matched, Rejected, Mask
ifc_pset = IFCSetProperty(
    Elements=ifcwall.Matched,
    PropertySet=property_set,
    Property=proprieta,
    Values=nuovo_valore,
    ValueType="Auto",
    OnType=False,
    Clear=False)  # -> Changes, Preview
read_ifc = Panel("MODELLO A")
ifc_filter_property = Panel("IfcWall")
nuova_descrizione = Panel("Verificato con Meerkat")
ifc_attr = IFCSetAttribute(Elements=ifcwall.Matched, Attribute="Description", Values=nuova_descrizione, OnType=False, Clear=False)  # -> Changes, Preview
nuovo_file_ifc_cambia_destinazione = Panel("C:\Users\g.pacini\Documents\Repository\IFC Viewer\exports\tutorial_modificato.ifc")
ifc_write = IFCWriteFile(
    Model=flatten(modello_a.Models),
    Changes=flatten([ifc_attr.Changes, ifc_pset.Changes]),
    File=nuovo_file_ifc_cambia_destinazione,
    Write=write_ifc,
    Overwrite=False)  # -> SavedFile, Report, Preview
ifc_set_attribute = Panel("IFC Attr")
ifc_set_property = Panel("IFC Pset")
ifc_write_file = Panel("IFC Write")
anteprima_modifiche = Panel(ifc_write.Preview)
file_scritto = Panel(ifc_write.SavedFile)
report_prima_dopo = Panel(ifc_write.Report)
