# Grasshopper definition 10_User_Text_a_IFC.ghx (Grasshopper 1.0.8)
# plug-ins: Meerkat

# 10 | DA USER TEXT A IFC: 1. BAKE crea le pareti. 2. Modifica in Rhino IFC.Property.Pset_WallCommon.FireRating o IFC.Attribute.Description.
# 3. REFRESH confronta SOLO le chiavi elencate con il modello originale. 4. Controlla l'anteprima, scegli un NUOVO percorso e premi WRITE IFC.
# Non alterare identificativi/hash. La geometria Rhino non viene trasferita da questo componente; valori mancanti non significano cancellazione.
read = Button()
bake = Button()
refresh = Button()
write_ifc = Button()
chiavi_da_trasferire_una_per_riga = Panel("""IFC.Property.Pset_WallCommon.FireRating
IFC.Attribute.Description""")
nuovo_ifc = Panel("C:\Users\g.pacini\Documents\Repository\IFC Viewer\exports\da_rhino.ifc")
file_ifc_cambia_percorso_poi_premi_read = Panel("C:\Users\g.pacini\Documents\Repository\IFC Viewer\examples\tutorial_A.ifc")
modello_a = ReadIFC(Files=flatten(file_ifc_cambia_percorso_poi_premi_read), Read=read)  # -> Models, Elements, Report
ifcwall = IFCFilterProperty(Elements=modello_a.Elements, Key="IFC.Class", Operator="=", Value="IfcWall", CaseSensitive=False)  # -> Matched, Rejected, Mask
ifc_bake = BakeIFC(Elements=flatten(ifcwall.Matched), Bake=bake, RootLayer="Esempio_10", Update=True, OffsetMetres=Vector(0, 0, 0))  # -> ObjectIDs, Report
ifc_rhino_edit = IFCChangesFromRhino(
    Model=flatten(modello_a.Models),
    RhinoIDs=flatten(ifc_bake.ObjectIDs),
    Keys=flatten(chiavi_da_trasferire_una_per_riga),
    Refresh=refresh)  # -> Changes, Preview, Report
ifc_write = IFCWriteFile(
    Model=flatten(modello_a.Models),
    Changes=flatten(ifc_rhino_edit.Changes),
    File=nuovo_ifc,
    Write=write_ifc,
    Overwrite=False)  # -> SavedFile, Report, Preview
read_ifc = Panel("MODELLO A")
ifc_filter_property = Panel("IfcWall")
bake_ifc = Panel("IFC Bake")
ifc_changes_from_rhino = Panel("IFC Rhino Edit")
sole_differenze = Panel(ifc_rhino_edit.Preview)
ifc_write_file = Panel("IFC Write")
report_di_scrittura = Panel(ifc_write.Report)
