# Grasshopper definition 11_Geometria_Rhino_a_IFC.ghx (Grasshopper 1.0.8)
# plug-ins: Meerkat

# 11 | GEOMETRIA RHINO A IFC: 1. BAKE centra localmente le pareti del modello a coordinate grandi. 2. Sposta/ruota/modifica una mesh in Rhino.
# 3. REFRESH prepara le sole differenze. 4. Scegli un nuovo percorso e premi WRITE IFC: il file ripristina le coordinate IFC originali piu le tue modifiche.
# Il Body diventa una mesh non parametrica. Qto, proprieta dimensionali, assi e modello analitico non sono ricalcolati. No aperture IFC o mesh aperte/disgiunte.
read = Button()
bake = Button()
refresh = Button()
write_ifc = Button()
nuovo_ifc = Panel("C:\Users\g.pacini\Documents\Repository\IFC Viewer\exports\geometria_modificata.ifc")
file_ifc_cambia_percorso_poi_premi_read = Panel("C:\Users\g.pacini\Documents\Repository\IFC Viewer\examples\tutorial_coordinate_grandi.ifc")
modello_a = ReadIFC(Files=flatten(file_ifc_cambia_percorso_poi_premi_read), Read=read)  # -> Models, Elements, Report
ifcwall = IFCFilterProperty(Elements=modello_a.Elements, Key="IFC.Class", Operator="=", Value="IfcWall", CaseSensitive=False)  # -> Matched, Rejected, Mask
ifc_origin = IFCLocalOrigin(Elements=ifcwall.Matched, Mode="XY center")  # -> OffsetMetres, OriginalOriginMetres
ifc_bake = BakeIFC(Elements=flatten(ifcwall.Matched), Bake=bake, RootLayer="Esempio_11", Update=True, OffsetMetres=ifc_origin.OffsetMetres)  # -> ObjectIDs, Report
ifc_rhino_mesh = IFCGeometryFromRhino(Model=flatten(modello_a.Models), RhinoIDs=flatten(ifc_bake.ObjectIDs), Refresh=refresh, ToleranceMetres=1e-06)  # -> Changes, Preview, Report
ifc_write = IFCWriteFile(
    Model=flatten(modello_a.Models),
    Changes=flatten(ifc_rhino_mesh.Changes),
    File=nuovo_ifc,
    Write=write_ifc,
    Overwrite=False)  # -> SavedFile, Report, Preview
limiti_della_conversione = Panel(ifc_rhino_mesh.Report)
read_ifc = Panel("MODELLO A")
ifc_filter_property = Panel("IfcWall")
ifc_local_origin = Panel("IFC Origin")
ifc_geometry_from_rhino = Panel("IFC Rhino Mesh")
bake_ifc = Panel("IFC Bake")
ifc_write_file = Panel("IFC Write")
geometrie_da_sostituire = Panel(ifc_rhino_mesh.Preview)
report_ifc = Panel(ifc_write.Report)
