# Grasshopper definition 12_Quantita_unita_anteprima.ghx (Grasshopper 1.0.8)
# plug-ins: Meerkat

# 12 | QUANTITA, UNITA E ANTEPRIMA: Le tre pareti hanno volume geometrico totale 12 m3. Geometry Metrics -> Set Quantity -> Preview Changes -> Property Units.
# Scriviamo Volume nel set custom Meerkat_Measured: il metodo e il volume della mesh chiusa, non una quantita netta/lorda standard dedotta automaticamente.
# Preview lavora su una copia temporanea; il modello originale resta invariato. WRITE esporta solo su richiesta.
read = Button()
write_ifc = Button()
metodo_di_misura = Panel("Volume geometrico della mesh chiusa in SI")
nuovo_ifc_percorso_modificabile = Panel("C:\Users\g.pacini\Documents\Repository\IFC Viewer\exports\12_quantita.ifc")
file_ifc_cambia_percorso_poi_premi_read = Panel("C:\Users\g.pacini\Documents\Repository\IFC Viewer\examples\tutorial_A.ifc")
modello_a = ReadIFC(Files=flatten(file_ifc_cambia_percorso_poi_premi_read), Read=read)  # -> Models, Elements, Report
ifcwall = IFCFilterProperty(Elements=modello_a.Elements, Key="IFC.Class", Operator="=", Value="IfcWall", CaseSensitive=False)  # -> Matched, Rejected, Mask
ifc_metrics = IFCGeometryMetrics(Elements=ifcwall.Matched, OffsetMetres=Vector(0, 0, 0))  # -> AreaM2, VolumeM3, HasVolume, DimensionsMetres, Boxes, Centers
ifc_qto = IFCSetQuantity(
    Elements=ifcwall.Matched,
    QuantitySet="Meerkat_Measured",
    Quantity="Volume",
    Values=ifc_metrics.VolumeM3,
    QuantityType="Volume",
    InputUnit="m3",
    MeasurementMethod=metodo_di_misura)  # -> Changes, Preview
ifc_preview = IFCPreviewChanges(Model=flatten(modello_a.Models), Changes=flatten(ifc_qto.Changes), Run=True)  # -> PreviewModel, Elements, AffectedBefore, AffectedAfter, Report
ifc_units = IFCPropertyUnits(Elements=ifc_preview.AffectedAfter, PropertySet="Meerkat_Measured", Property="Volume", TargetUnit="m3")  # -> Values, SourceUnits, Valid, Details
ma = MassAddition(Input=ifc_units.Values)  # -> Result, PartialResults
ifc_write = IFCWriteFile(
    Model=flatten(modello_a.Models),
    Changes=flatten(ifc_qto.Changes),
    File=nuovo_ifc_percorso_modificabile,
    Write=write_ifc,
    Overwrite=False)  # -> SavedFile, Report, Preview
read_ifc = Panel("MODELLO A")
ifc_filter_property = Panel("IfcWall")
ifc_set_quantity = Panel("IFC Qto")
ifc_property_units = Panel("IFC Units")
ifc_geometry_metrics = Panel("IFC Metrics")
quantita_rilette_4_5_4_5_3_m3 = Panel(ifc_units.Values)
ifc_preview_changes = Panel("IFC Preview")
ifc_write_file = Panel("IFC Write")
mass_addition = Panel("MA")
prima_dopo_richieste_realmente_applicate = Panel(ifc_preview.Report)  # "PRIMA / DOPO | richieste realmente applicate alla copia"
report_export_nessun_file_finche_non_pre = Panel(ifc_write.Report)  # "REPORT EXPORT | nessun file finche non premi WRITE"
totale_atteso_12_m3 = Panel(ma.Result)
