# Grasshopper definition 13_Relazioni_e_materiali.ghx (Grasshopper 1.0.8)
# plug-ins: Meerkat

col = Colour(RGB(0, 128, 128))
# 13 | RELAZIONI E MATERIALI: Seleziona le pareti e naviga le relazioni esplicite verso i tipi. Un ramo per ogni parete di ingresso.
# Materials & Layers legge assegnazioni di istanza o ereditate: nomi, strati, spessori in metri e profili con metadati originali.
# Cambia Relation in Container, Parent, Parts, Groups, Openings o Connections; Recursive segue la stessa relazione senza cicli.
read = Button()
file_ifc_cambia_percorso_poi_premi_read = Panel("C:\Users\g.pacini\Documents\Repository\IFC Viewer\examples\tutorial_A.ifc")
modello_a = ReadIFC(Files=flatten(file_ifc_cambia_percorso_poi_premi_read), Read=read)  # -> Models, Elements, Report
ifcwall = IFCFilterProperty(Elements=modello_a.Elements, Key="IFC.Class", Operator="=", Value="IfcWall", CaseSensitive=False)  # -> Matched, Rejected, Mask
ifc_relations = IFCRelationships(Elements=ifcwall.Matched, Relation="Type", Recursive=False)  # -> RelatedElements, Details
ifc_materials = IFCMaterialsLayers(Elements=ifcwall.Matched)  # -> MaterialNames, ThicknessMetres, Profiles, Scope, Details
pareti = IFCElements(Elements=ifcwall.Matched, OffsetMetres=Vector(0, 0, 0))  # -> Geometry, Elements, Classes, GlobalIds, Keys, Values, JSON, Colors
pareti_2 = CustomPreview(Geometry=pareti.Geometry, Material=col)
read_ifc = Panel("MODELLO A")
ifc_elements = Panel("PARETI")
ifc_filter_property = Panel("IfcWall")
ifc_materials_layers = Panel("IFC Materials")
ifc_relationships = Panel("IFC Relations")
materiali_ordine_degli_strati_componenti = Panel(ifc_materials.MaterialNames)
dettagli_scope_offset_proprieta_e_profil = Panel(ifc_materials.Details)  # "DETTAGLI | scope, offset, proprieta e profili"
tipi_correlati_i_rami_mantengono_l_origi = Panel(ifc_relations.RelatedElements)  # "TIPI CORRELATI | i rami mantengono l'origine"
spessori_in_metri_nan_se_non_e_uno_strat = Panel(ifc_materials.ThicknessMetres)  # "SPESSORI IN METRI | NaN se non e uno strato"
