# Grasshopper definition 14_Importa_tabella.ghx (Grasshopper 1.0.8)
# plug-ins: Meerkat

# 14 | IMPORTAZIONE CSV: La tabella UTF-8 aggiorna Description e FireRating delle tre pareti tramite IFC.GlobalId. Il testo CSV e incorporato nel pannello.
# Import Table valida le colonne scelte, identita, tipi e conflitti; un errore blocca tutto il batch. I valori vuoti sono testo vuoto, non cancellazioni.
# Puoi sostituire CSV con il percorso 14_aggiornamento.csv. Preview mostra la copia modificata; WRITE salva un nuovo IFC.
read = Button()
write_ifc = Button()
csv_testo_multilinea_modificabile = Panel("""IFC.GlobalId;IFC.Attribute.Description;IFC.Property.Pset_WallCommon.FireRating
3xCZU1$HbDZgoec6JcBxEt;Verificato da tabella;REI 90
2u50pW$4j3HxUq8q8UdE9C;Verificato da tabella;REI 90
3SszIEOxjL4wUFtsWJ3SO_;Verificato da tabella;REI 90""")
nuovo_ifc_percorso_modificabile = Panel("C:\Users\g.pacini\Documents\Repository\IFC Viewer\exports\14_tabella.ifc")
file_ifc_cambia_percorso_poi_premi_read = Panel("C:\Users\g.pacini\Documents\Repository\IFC Viewer\examples\tutorial_A.ifc")
modello_a = ReadIFC(Files=flatten(file_ifc_cambia_percorso_poi_premi_read), Read=read)  # -> Models, Elements, Report
ifc_table = IFCImportTable(
    Model=flatten(modello_a.Models),
    CSV=csv_testo_multilinea_modificabile,
    Columns=["IFC.Attribute.Description", "IFC.Property.Pset_WallCommon.FireRating"],
    Separator=";",
    Read=True)  # -> Changes, Valid, Report
ifc_preview = IFCPreviewChanges(Model=flatten(modello_a.Models), Changes=flatten(ifc_table.Changes), Run=True)  # -> PreviewModel, Elements, AffectedBefore, AffectedAfter, Report
ifc_write = IFCWriteFile(
    Model=flatten(modello_a.Models),
    Changes=flatten(ifc_table.Changes),
    File=nuovo_ifc_percorso_modificabile,
    Write=write_ifc,
    Overwrite=False)  # -> SavedFile, Report, Preview
read_ifc = Panel("MODELLO A")
ifc_import_table = Panel("IFC Table")
ifc_preview_changes = Panel("IFC Preview")
ifc_write_file = Panel("IFC Write")
validazione_righe = Panel(ifc_table.Report)
differenze_effettive = Panel(ifc_preview.Report)
report_export_nessun_file_finche_non_pre = Panel(ifc_write.Report)  # "REPORT EXPORT | nessun file finche non premi WRITE"
