# Grasshopper definition 15_Validazione_IDS.ghx (Grasshopper 1.0.8)
# plug-ins: Meerkat

col = Colour(RGB(34, 139, 34))
col_2 = Colour(RGB(205, 92, 92))
# 15 | VALIDAZIONE IDS: Il file 15_requisiti.ids richiede Codice e FireRating per le pareti. Attesi: 2 pareti conformi, 1 senza codice; esito globale False.
# I requisiti provengono dall'IDS, non sono controlli strutturali o normativi. Il report include motivazioni e specifiche non soddisfatte.
# Il percorso relativo viene cercato accanto al GH e negli examples della distribuzione. Sostituiscilo con il tuo IDS.
read = Button()
requisiti_ids = Panel("15_requisiti.ids")
file_ifc_cambia_percorso_poi_premi_read = Panel("C:\Users\g.pacini\Documents\Repository\IFC Viewer\examples\tutorial_A.ifc")
modello_a = ReadIFC(Files=flatten(file_ifc_cambia_percorso_poi_premi_read), Read=read)  # -> Models, Elements, Report
ifc_ids = IFCValidateIDS(Model=flatten(modello_a.Models), IDSFile=requisiti_ids, Run=True)  # -> Passed, Failed, Valid, Issues, Report
conformi = IFCElements(Elements=ifc_ids.Passed, OffsetMetres=Vector(0, 0, 0))  # -> Geometry, Elements, Classes, GlobalIds, Keys, Values, JSON, Colors
conformi_2 = CustomPreview(Geometry=conformi.Geometry, Material=col)
da_correggere = IFCElements(Elements=ifc_ids.Failed, OffsetMetres=Vector(0, 0, 0))  # -> Geometry, Elements, Classes, GlobalIds, Keys, Values, JSON, Colors
da_correggere_2 = CustomPreview(Geometry=da_correggere.Geometry, Material=col_2)
read_ifc = Panel("MODELLO A")
ifc_elements = Panel("CONFORMI")
ifc_elements_2 = Panel("DA CORREGGERE")
ifc_validate_ids = Panel("IFC IDS")
errori_parete_priva_del_codice = Panel(ifc_ids.Issues)
report_ids_completo = Panel(ifc_ids.Report)
