# Grasshopper definition 16_Tipi_ed_estrazione.ghx (Grasshopper 1.0.8)
# plug-ins: Meerkat

# 16 | TIPI ED ESTRAZIONE: Duplica il tipo corrente per le tre pareti selezionate, con Pset indipendenti. Le istanze dello stesso tipo sorgente condividono la nuova copia.
# Preview elenca i valori ereditati prima/dopo. Assign Type va applicato in un passaggio separato da altre modifiche sugli stessi oggetti/tipi.
# EXTRACT esporta le pareti della copia e include antenati, materiali e tipi necessari. Nessun export all'apertura.
read = Button()
extract = Button()
nuovo_ifc_parziale = Panel("C:\Users\g.pacini\Documents\Repository\IFC Viewer\exports\16_selezione.ifc")
file_ifc_cambia_percorso_poi_premi_read = Panel("C:\Users\g.pacini\Documents\Repository\IFC Viewer\examples\tutorial_A.ifc")
modello_a = ReadIFC(Files=flatten(file_ifc_cambia_percorso_poi_premi_read), Read=read)  # -> Models, Elements, Report
ifcwall = IFCFilterProperty(Elements=modello_a.Elements, Key="IFC.Class", Operator="=", Value="IfcWall", CaseSensitive=False)  # -> Matched, Rejected, Mask
ifc_type = IFCAssignType(Elements=ifcwall.Matched, Duplicate=True, NewTypeName="Pareti - Variante Meerkat", ApplyTypeGeometry=False)  # -> Changes, Preview
ifc_preview = IFCPreviewChanges(Model=flatten(modello_a.Models), Changes=flatten(ifc_type.Changes), Run=True)  # -> PreviewModel, Elements, AffectedBefore, AffectedAfter, Report
ifc_extract = IFCExtractModel(
    Elements=flatten(ifc_preview.AffectedAfter),
    File=nuovo_ifc_parziale,
    IncludeDescendants=True,
    Write=extract,
    Overwrite=False)  # -> SavedFile, Report
read_ifc = Panel("MODELLO A")
ifc_filter_property = Panel("IfcWall")
ifc_preview_changes = Panel("IFC Preview")
ifc_extract_model = Panel("IFC Extract")
ifc_assign_type = Panel("IFC Type")
tipi_e_proprieta_prima_dopo = Panel(ifc_preview.Report)
dipendenze_incluse = Panel(ifc_extract.Report)
