# Grasshopper definition 17_Interferenze.ghx (Grasshopper 1.0.8)
# plug-ins: Meerkat

col = Colour(RGBA(100, 140, 150, 100))
# 17 | INTERFERENZE E DISTANZE: Collision con Include touching=True individua i 2 contatti fra pareti e solaio del modello demo.
# Intersection cerca penetrazioni oltre tolleranza; Clearance cerca superfici piu vicine di Distance metres. Le coordinate dei modelli devono essere gia coerenti.
# Escludi classi o coppie IFC.Key|IFC.Key. I punti sono indicativi e Distance dipende da Kind; non e un volume di intersezione.
read = Button()
file_ifc_cambia_percorso_poi_premi_read = Panel("C:\Users\g.pacini\Documents\Repository\IFC Viewer\examples\demo.ifc")
modello_a = ReadIFC(Files=flatten(file_ifc_cambia_percorso_poi_premi_read), Read=read)  # -> Models, Elements, Report
ifcwall = IFCFilterProperty(Elements=modello_a.Elements, Key="IFC.Class", Operator="=", Value="IfcWall", CaseSensitive=False)  # -> Matched, Rejected, Mask
ifcslab = IFCFilterProperty(Elements=modello_a.Elements, Key="IFC.Class", Operator="=", Value="IfcSlab", CaseSensitive=False)  # -> Matched, Rejected, Mask
ifc_clash = IFCClashClearance(
    SetA=flatten(ifcwall.Matched),
    SetB=flatten(ifcslab.Matched),
    Mode="Collision",
    DistanceMetres=0.002,
    IncludeTouching=True,
    Offset=Vector(0, 0, 0),
    Run=True)  # -> Pairs, PointsA, PointsB, DistanceMetres, Kind, Report
modello = IFCElements(Elements=modello_a.Elements, OffsetMetres=Vector(0, 0, 0))  # -> Geometry, Elements, Classes, GlobalIds, Keys, Values, JSON, Colors
modello_2 = CustomPreview(Geometry=modello.Geometry, Material=col)
ifc_elements = Panel("MODELLO")
read_ifc = Panel("MODELLO A")
ifc_filter_property = Panel("IfcWall")
ifc_filter_property_2 = Panel("IfcSlab")
ifc_clash_clearance = Panel("IFC Clash")
report_inclusi_oggetti_non_verificabili = Panel(ifc_clash.Report)
coppie_due_elementi_in_ogni_ramo = Panel(ifc_clash.Pairs)
tipo_di_interferenza = Panel(ifc_clash.Kind)
