# Grasshopper definition 18_Modello_strutturale.ghx (Grasshopper 1.0.8)
# plug-ins: Meerkat

# 18 | MODELLO STRUTTURALE ANALITICO: IFC di prova: trave rettilinea di 5 m a quota 3 m, due connessioni, una cerniera e un carrello. Sul nodo 2 e applicato Fz=-10000 N in coordinate globali.
# Il componente legge entita analitiche IFC realmente presenti; non ricostruisce un FEM dalle mesh e non verifica stabilita o correttezza dello schema.
# Assi/punti sono nelle unita Rhino; carichi e rigidezze mantengono unita e sistemi locali/globali IFC, indicati nel report.
read = Button()
file_ifc_cambia_percorso_poi_premi_read = Panel("C:\Users\g.pacini\Documents\Repository\IFC Viewer\examples\tutorial_struttura.ifc")
modello_a = ReadIFC(Files=flatten(file_ifc_cambia_percorso_poi_premi_read), Read=read)  # -> Models, Elements, Report
ifc_structural = IFCStructuralModel(Model=flatten(modello_a.Models), Offset=Vector(0, 0, 0))  # -> GlobalIds, AxesBoundaries, NodesVertices, ConnectionsConditions, Loads, Report
vincoli_true_fisso_false_libero_null_non = Panel(ifc_structural.ConnectionsConditions)  # "VINCOLI | TRUE fisso, FALSE libero, null non specificato"
modello_gruppi_unita_e_grafi_ifc = Panel(ifc_structural.Report)
read_ifc = Panel("MODELLO A")
ifc_structural_model = Panel("IFC Structural")
carichi_fz_10000_n = Panel(ifc_structural.Loads)
membro_e_connessioni_globalid = Panel(ifc_structural.GlobalIds)
