# Grasshopper definition IFCViewer-legacy.gh (Grasshopper 1.0.8)
# plug-ins: IFC Viewer

# IFC VIEWER | Rhino 8 / Windows: 1. Modifica il percorso IFC e premi READ.
# 2. Filtra le classi IFC e consulta attributi/valori.
# 3. Premi BAKE per creare mesh con User Text.
# 4. Salva .gh e .3dm; SAVE esporta l'archivio completo.
# Il modello dimostrativo e gia incorporato nel .gh.
read = Button()
bake = Button()
save = Button()
write_csv = Button()
write_3dm = Button()
refresh = Button()
file_ifc_un_percorso_per_riga = Panel("C:\Users\g.pacini\Documents\Repository\IFC Viewer\examples\demo.ifc")
ifc_read = ReadIFC(Files=flatten(file_ifc_un_percorso_per_riga), Read=read)  # -> Models, Elements, Report
ifc_info = IFCModelInfo(Models=ifc_read.Models)  # -> Names, Schemas, Products, Meshes, LengthToMetres, Classes, ClassCounts, JSON
ifc_diff = IFCCompareRevisions(Before=ifc_read.Models, After=ifc_read.Models, CompareMeshes=True, PrecisionMetres=1e-06)  # -> Added, Removed, ChangedBefore, ChangedAfter, Unchanged, ChangedFields, Report
report_lettura = Panel(ifc_read.Report)
# 05 | ESPORTA E RILEGGI IL BAKE: CSV: una riga per oggetto, parametri per colonna. 3DM: mesh, layer e User Text.
# WRITE agisce solo quando premi il Button; Overwrite e disattivato.
# Bake ed export uniscono automaticamente i rami di elementi in una lista.
# Read Baked consulta i dati gia presenti nel documento Rhino; usa Refresh dopo modifiche.
# IFC Export CSV: Esporta un abaco UTF-8 con un oggetto per riga e parametri per colonna. Scrittura solo su fronte False -> True.
file_csv = Panel("C:\Users\g.pacini\Documents\Repository\IFC Viewer\exports\abaco.csv")
# IFC Export 3DM: Esporta gli elementi in un nuovo .3dm con layer e User Text, senza aggiungere oggetti al documento attivo.
file_3dm = Panel("C:\Users\g.pacini\Documents\Repository\IFC Viewer\exports\selezione.3dm")
classi_vuoto_tutte = Panel("")
ifc_data = IFCElements(Elements=ifc_read.Elements, Classes=classi_vuoto_tutte, OffsetMetres=Vector(0, 0, 0))  # -> Geometry, Elements, Classes, GlobalIds, Keys, Values, JSON, Colors
ifc_bake = BakeIFC(Elements=flatten(ifc_data.Elements), Bake=bake, RootLayer="IFC", Update=True, OffsetMetres=Vector(0, 0, 0))  # -> ObjectIDs, Report
preview = CustomPreview(Geometry=ifc_data.Geometry, Material=ifc_data.Colors)
ifc_keys = IFCPropertyKeys(Elements=ifc_data.Elements, Search="FireRating")  # -> Keys, Occurrences
ifc_group = IFCGroupBy(Elements=ifc_data.Elements, Key="IFC.Container.name")  # -> Groups, Labels, Counts, KeyExists
ifc_sort = IFCSort(Elements=ifc_data.Elements, Key="IFC.Name", Numeric=False, Descending=False)
ifc_metrics = IFCGeometryMetrics(Elements=ifc_data.Elements, OffsetMetres=Vector(0, 0, 0))  # -> AreaM2, VolumeM3, HasVolume, DimensionsMetres, Boxes, Centers
ifc_origin = IFCLocalOrigin(Elements=ifc_data.Elements, Mode="XY center")  # -> OffsetMetres, OriginalOriginMetres
ifc_colors = IFCColorBy(Elements=ifc_data.Elements, Key="IFC.Container.name", OffsetMetres=Vector(0, 0, 0))  # -> Geometry, Colors, Legend, LegendColors, Counts, KeyExists
preview_2 = CustomPreview(Geometry=ifc_colors.Geometry, Material=ifc_colors.Colors)
ifc_check = IFCCheckData(Elements=ifc_data.Elements, RequiredKeys="IFC.GlobalId", RequireGeometry=False)  # -> Passed, Failed, Valid, Issues
ifc_csv = IFCExportCSV(
    Elements=flatten(ifc_data.Elements),
    Keys=flatten(["IFC.GlobalId", "IFC.Class", "IFC.Name", "IFC.Container.name", "IFC.Property.Pset_WallCommon.FireRating"]),
    File=file_csv,
    Write=write_csv,
    Overwrite=False,
    Delimiter=";",
    ExcelSafe=True)
ifc_3dm = IFCExport3DM(
    Elements=flatten(ifc_data.Elements),
    File=file_3dm,
    Write=write_3dm,
    Overwrite=False,
    OffsetMetres=Vector(0, 0, 0),
    RootLayer="IFC")  # -> SavedFile, Report
ifc_baked = IFCReadBaked(RhinoObjectIDs=ifc_bake.ObjectIDs, Refresh=refresh)  # -> RhinoIDs, Geometry, Keys, Values, MetadataJSON, NotFound
cartella_archivi = Panel("C:\Users\g.pacini\Documents\Repository\IFC Viewer\exports")
ifc_save = SaveIFCArchive(Models=flatten(ifc_read.Models), Directory=cartella_archivi, Save=save, Overwrite=False)
attributi_ramo_i_oggetto_i = Panel(ifc_data.Keys)
csv_salvato = Panel(ifc_csv)
report_3dm = Panel(ifc_3dm.Report)
# IFC Read Baked: Rilegge geometrie e User Text degli oggetti IFC gia presenti nel documento Rhino. Premere Refresh dopo modifiche al documento.
chiavi_dagli_oggetti_rhino = Panel(ifc_baked.Keys)
tipologie_ifc = Panel(ifc_data.Classes)
valori_stesso_ramo_e_indice = Panel(ifc_data.Values)
valori_dagli_oggetti_rhino = Panel(ifc_baked.Values)
report_bake = Panel(ifc_bake.Report)
archivi_salvati = Panel(ifc_save)
# IFC Property Keys: Elenco unificato delle chiavi e numero di oggetti in cui ogni chiave e presente.
# IFC Filter Property: Separa gli oggetti in base a un parametro. Collegare piu filtri in serie per combinare condizioni AND.
parametro_da_leggere_filtrare = Panel("IFC.Property.Pset_WallCommon.FireRating")
ifc_value = IFCPropertyValue(Elements=ifc_data.Elements, Key=parametro_da_leggere_filtrare)  # -> Values, Found, Numbers, IsNumeric
ifc_filter = IFCFilterProperty(Elements=ifc_data.Elements, Key=parametro_da_leggere_filtrare, Operator="=", Value="REI 60", CaseSensitive=False)  # -> Matched, Rejected, Mask
# IFC Select IDs: Seleziona GlobalId, #STEP-ID oppure chiavi sorgente:GlobalId. I GlobalId distinguono maiuscole/minuscole.
globalid_di_esempio_sostituire = Panel("3xCZU1$HbDZgoec6JcBxEt")
ifc_ids = IFCSelectIDs(Elements=ifc_data.Elements, IDs=globalid_di_esempio_sostituire)  # -> Elements, Indices, NotFound, Ambiguous
# 02 | INTERROGA E ORGANIZZA: Tutti questi componenti lavorano sulla selezione di IFC Elements.
# Le chiavi sono quelle di IFC Property Keys.
# Filtro numerico: punto decimale, unita originali IFC.
# Il risultato di un filtro puo essere collegato a Bake, Export o a un altro filtro.
# IFC Model Info: Schema, sorgenti, unita, conteggi e classi dei modelli caricati.
classi_presenti = Panel(ifc_info.Classes)
# IFC Property Value: Estrae un parametro per ogni oggetto mantenendo allineamento e valori mancanti.
chiavi_disponibili_ricerca_firerating = Panel(ifc_keys.Keys)
filtro_esempio_firerating_rei_60 = Panel(ifc_filter.Matched)
# IFC Group By: Raggruppa per classe, piano, materiale o qualsiasi parametro. Ogni gruppo ha un ramo.
gruppi_per_piano_contenitore = Panel(ifc_group.Labels)
# IFC Sort: Ordina stabilmente gli oggetti per un parametro, come testo o numero. Valori assenti/non numerici in fondo.
oggetti_ordinati_per_nome = Panel(ifc_sort)
oggetti_selezionati_per_id = Panel(ifc_ids.Elements)
quantita_per_classe = Panel(ifc_info.ClassCounts)
conteggi = Panel(ifc_group.Counts)
valori_vuoto_assente = Panel(ifc_value.Values)
# 03 | VISUALIZZAZIONE E MISURE: Le aree e i volumi derivano dalle mesh e sono sempre in m2/m3.
# I box/centri per la viewport sono nelle unita Rhino.
# Local Origin produce un offset comune: collegarlo sia alla preview sia al bake/export.
# Color By fornisce G e C da collegare a Custom Preview; qui la preview aggiuntiva e disattivata.
# IFC Geometry Metrics: Area e volume delle mesh in SI; non sostituiscono i Quantity Set IFC. Volume NaN per mesh non chiuse/orientate.
area_superficiale_m2 = Panel(ifc_metrics.AreaM2)
# IFC Local Origin: Calcola un offset comune in metri per avvicinare un modello/federazione all'origine. Collegarlo sia alla preview sia al bake/export.
offset_suggerito_metri_non_ancora_applic = Panel(ifc_origin.OffsetMetres)  # "OFFSET SUGGERITO | metri; non ancora applicato"
# IFC Color By: Colori categoriali deterministici per un parametro. Collegare Geometry e Colors a Custom Preview.
legenda_colori_per_piano = Panel(ifc_colors.Legend)
# 04 | CONTROLLO DATI E REVISIONI: Check Data verifica le chiavi richieste e, opzionalmente, la presenza di mesh.
# Compare Revisions confronta un modello prima/dopo tramite GlobalId.
# Esempio iniziale: entrambi gli input sono sullo stesso modello, quindi nessuna modifica.
# Aggiungere un secondo Read IFC e collegare Models all'input B per confrontare un'altra revisione.
# IFC Check Data: Controlla parametri richiesti, GlobalId duplicati/mancanti e disponibilita delle mesh. Non e una validazione normativa IFC.
problemi_ramo_indice_oggetto_originale = Panel(ifc_check.Issues)
# IFC Compare Revisions: Confronta due modelli per GlobalId: aggiunti, rimossi, dati cambiati e mesh cambiate. Ignora rinumerazione STEP e OwnerHistory.
confronto_revisioni = Panel(ifc_diff.Report)
campi_modificati = Panel(ifc_diff.ChangedFields)
volume_m3_nan_se_non_calcolabile = Panel(ifc_metrics.VolumeM3)
conteggi_per_colore = Panel(ifc_colors.Counts)
